% Simulink data dictionary Driver.sldd

DriverInitialGear = 0
DriverDelayGain = 0.01
DriverYawRateGain = 0.2
DriverShiftTime = 0.1
DriverFrontCornerStiff = 40000
DriverRearCornerStiff = 40000
DriverPreviewDist = 6
DriverTimeConst = 0.3
DriverAeroRes = 0.5
DriverDrivelineRes = 75
DriverRollRes = 800
DriverTractiveForce = 14000
DriverPositionGainF = 6
DriverPositionGainR = 0.25
DriverWheelRange = 1.047198