% Simulink data dictionary ElectricMachine1.sldd

PlntEM1TimeCnst = 0.02
PlntEM1ExtSplySerRes = 0
PlntEM1RotDamp = 0.001
PlntEM1RotInertia = 0.01
PlntEM1RotInitSpd = 0
PlntEM1SpdLoss = [0 139.6263 279.2527 418.879 468.8889 558.5054 698.1317 837.758 977.3844 1117.011 1256.637 1396.263 1535.89 1675.516]
PlntEM1TrqLoss = [0 45 90 135 180 225 270 315 360 405 450]
PlntEMCp = 385
PlntEMMass = 65
PlntEMThrmMass = Simulink.Parameter(Simulink.data.Expression(ExpressionString="PlntEMMass*PlntEMCp"))
PlntEM1VPwrLoss = [100 300 500 700 900]
PlntEM1PwrLossTbl = reshape([1 1 1 1 1 1 1 1 1 1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], 19, 17, 5, 3)
PlntEM1VEff = [100 300 500 700 900]
PlntEM1TempEff = [-40 20 90]
PlntEM1SpdEff = [0 139.6263 279.2527 418.879 468.8889 558.5054 698.1317 837.758 977.3844 1117.011 1256.637 1396.263 1535.89 1675.516]
PlntEM1TrqEff = [0 45 90 135 180 225 270 315 360 405 450]

PlntEM1EffTbl = [52 78 80 82 82 80 78 78 76 74 70
 52 78 80 82 82 80 78 78 76 74 70
 52 78 84 86 86 86 86 84 84 82 82
 52 80 86 86 88 88 88 86 86 84 84
 52 80 86 88 88 88 88 88 86 86 86
 52 80 86 88 90 90 90 90 88 88 88
 52 82 88 90 91 91 92 92 92 91 91
 52 82 88 91 91 92 93 93 93 93 93
 52 84 90 92 92 93 93 93 93 93 93
 62 86 91 93 93 93 93 93 93 93 93
 66 86 91 93 93 93 93 93 93 93 93
 70 86 92 93 93 93 93 93 93 93 93
 70 86 92 93 93 93 93 93 93 93 93
 72 86 91 93 93 93 93 93 93 93 93]

PlntEM1TempPwrLoss = [233.15 293.15 363.15]

PlntEM1TrqLossTbl = [0 0 0 0 0 0 0 0 0 0 0
 0 1772.2 3141.6 4137.7 5516.9 7854 10633.1 12405.3 15873.3 19868.5 26927.9
 0 3544.4 4787.2 6137.1 8182.8 10228.4 12274.1 16755.2 19148.8 24826.2 27584.7
 0 4712.4 6137.1 9205.6 10281.6 12852 15422.4 21479.7 24548.3 32313.5 35903.9
 0 5275 6869.8 8631.8 11509.1 14386.4 17263.6 20140.9 27479.1 30914 34348.8
 0 6283.2 8182.8 10281.6 11170.1 13962.6 16755.2 19547.7 27417.5 30844.7 34271.9
 0 6896.2 8568 10472 12428.3 15535.3 16390.9 19122.7 21854.6 27963.6 31070.7
 0 8275.4 10281.6 11185.5 14913.9 16390.9 17025.4 19863 22700.5 25538.1 28375.7
 0 8377.6 9773.8 11473.6 15298.2 16552.5 19863 23173.5 26484 29794.5 33105
 0 8182.8 9942.6 11350.3 15133.7 18917.1 22700.5 26484 30267.4 34050.8 37834.2
 0 9205.6 11185.5 12769.1 17025.4 21281.8 25538.1 29794.5 34050.8 38307.2 42563.5
 0 10228.4 10927.3 14187.8 18917.1 23646.4 28375.7 33105 37834.2 42563.5 47292.8
 0 11251.3 12020 15606.6 20808.8 26011 31213.2 36415.5 41617.7 46819.9 52022.1
 0 12274.1 14913.9 17025.4 22700.5 28375.7 34050.8 39725.9 45401.1 51076.2 56751.4]

PlntEM1Spd = [0 81.8472 163.6944 245.5416 327.3889 409.2361 446.4203 491.0833 572.9305 654.7777 736.6249 818.4722 900.3194 982.1666]
PlntEM1Trq = [112 112 112 112 112 112 112 101.8 87.3 76.4 67.9 61.1 55.5 50.9]
PlntEM1EffPwrLossSpdBpt = [0 81.8472 163.6944 245.5416 327.3889 409.2361 446.4203 491.0833 572.9305 654.7777 736.6249 818.4722 900.3194 982.1666]
PlntEM1EffPwrLossTrqBpt = [0 11.2 22.4 33.6 44.8 56 67.2 78.4 89.6 100.8 112]
PlntEM1EffPwrLossTempBpt = [233.15 293.15 363.15]
PlntEM1EffPwrLossVoltBpt = [100 300 500 700 900]
PlntEM1LossesTbl4d = reshape([0 0 0 0 0 0 0 0 0 0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], 11, 14, 5, 3)
PlntEM1EffTbl4d = reshape([52 78 80 82 82 80 78 78 76 74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], 11, 14, 5, 3)

PlntEM1MaxTqTbl = [112 112 112 112 112
 112 112 112 112 112
 112 112 112 112 112
 112 112 112 112 112
 112 112 112 112 112
 94.02773 94.02773 94.02773 94.02773 94.02773
 75.22418 75.22418 75.22418 75.22418 75.22418
 62.68516 62.68516 62.68516 62.68516 62.68516
 53.73013 53.73013 53.73013 53.73013 53.73013
 47.01511 47.01511 47.01511 47.01511 47.01511
 41.79093 41.79093 41.79093 41.79093 41.79093
 37.61209 37.61209 37.61209 37.61209 37.61209
 34.19236 34.19236 34.19236 34.19236 34.19236
 31.34258 31.34258 31.34258 31.34258 31.34258]

PlntEM1MaxTqSpdBpt = [0 81.8472 163.6944 245.5416 327.3889 409.2361 446.4203 491.0833 572.9305 654.7777 736.6249 818.4722 900.3194 982.1666]
PlntEM1MaxTqVoltBpt = [100 300 500 700 900]

PlntEM1MinTqTbl = [-112 -112 -112 -112 -112
 -112 -112 -112 -112 -112
 -112 -112 -112 -112 -112
 -112 -112 -112 -112 -112
 -112 -112 -112 -112 -112
 -94.02773 -94.02773 -94.02773 -94.02773 -94.02773
 -75.22418 -75.22418 -75.22418 -75.22418 -75.22418
 -62.68516 -62.68516 -62.68516 -62.68516 -62.68516
 -53.73013 -53.73013 -53.73013 -53.73013 -53.73013
 -47.01511 -47.01511 -47.01511 -47.01511 -47.01511
 -41.79093 -41.79093 -41.79093 -41.79093 -41.79093
 -37.61209 -37.61209 -37.61209 -37.61209 -37.61209
 -34.19236 -34.19236 -34.19236 -34.19236 -34.19236
 -31.34258 -31.34258 -31.34258 -31.34258 -31.34258]

PlntEM1MinTqSpdBpt = [0 81.8472 163.6944 245.5416 327.3889 409.2361 446.4203 491.0833 572.9305 654.7777 736.6249 818.4722 900.3194 982.1666]
PlntEM1MinTqVoltBpt = [100 300 500 700 900]
PlntEMNum = 4