% Simulink data dictionary PassVeh.sldd

PlntVehMass = 1623
PlntWhlLongScaleFctr = 0.9
PlntBrkFrntBias = 1
PlntBrkRearBias = 0.6
PlntBrkPrsFctr = 8000000
PlntVehNumWhlFrntAxl = 2
PlntVehNumWhlRearAxl = 2
PlntVehDstCGFrntAxl = 1.09
PlntVehDstCGRearAxl = 1.7
PlntVehRollResCffa = 196
PlntVehRollResCffb = 2.232
PlntVehCGHgtAxl = 0.3
PlntVehInitLongVel = 0
PlntVehInitLatVel = 0
PlntVehInitVertVel = 0
PlntVehInitRollRate = 0
PlntVehInitPitchRate = 0
PlntVehInitYawRate = 0
PlntVehRollMomentInertia = 432.3333
PlntVehYawMomentInertia = 2066
PlntVehTrckWdth = [1.575 1.575]
PlntVehFrntUnsprgMass = 100
PlntVehRearUnsprgMass = 100
PlntSteerRackDispBpt = [-40 -19.2 -4.53 4.53 19.2 40]
PlntSteerGearRatio = 52.02477
PlntSteerLftWhlAngTbl = [-0.3490659 -0.1675516 -0.0395608 0.0395608 0.1675516 0.3490659]
PlntSteerRghtWhlAngTbl = [-0.3490659 -0.1675516 -0.0395608 0.0395608 0.1675516 0.3490659]
PlntSteerRange = 28.27433
PlntSteerPctAck = 100
PlntVehAeroFrntArea = 2.27
PlntVehAeroLiftCff = 0.1
PlntVehAeroPitchCff = 0.1
PlntSteerUpperInertia = 0.1
PlntSteerLowerInertia = 0.01
PlntSteerHysStiff = 30
PlntSteerWheelTrqBpt = [-100 0 100]
PlntSteerTrqAsstTbl = [0 -100; 0 0; 0 100]
PlntSpKCMotRatios = [1 1]
PlntSpKCBumpSteer = [0 0 0 0]
PlntSpKCBumpCamber = [0 0 0 0]
PlntSpKCBumpCaster = [0 0 0 0]
PlntSpKCLngWhlCtrDisp = [0 0 0 0]
PlntSpKCRollStiffArb = [0 0]
PlntSpKCRollStiffNoArb = [0 0]
PlntSpKCCambVsSteerAng = [0 0 0 0]
PlntSpKCCastVsSteerAng = [0 0 0 0]
PlntSpKCLngSteerCompl = repmat(0, 2, 4)
PlntSpKCLngCambCompl = repmat(0, 2, 4)
PlntSpKCLngCastCompl = repmat(0, 2, 4)
PlntSpKCLngWhlCtrCompl = repmat(0, 2, 4)
PlntSpKCLatSteerCompl = [0 0 0 0]
PlntSpKCLatCambCompl = [0 0 0 0]
PlntSpKCAlgnTrqSteerCompl = [0 0 0 0]
PlntSpKCAlgnTrqCambCompl = [0 0 0 0]
PlntSpStatLdWhlR = [0.3 0.3 0.3 0.3]
PlntSpMSPreload = 2886
PlntSpMSMaxHeight = 0.25
PlntSpMSHeightVsSteer = 0.1432
PlntSpMSAntiSwayRadius = 0.2
PlntSpMSAntiSwayNeutralAngle = 0.5236
PlntSpMSAntiSwayTorsionStiffness = 800
PlntSpSARollInertia = 62.37452
PlntSpSAAxleMass = 160
PlntSpSAAxleWheelStiffness = 138031.6
PlntSpSAAxleWheelDamping = 11490.97
PlntSpSAAxleWheelPreload = 2907
PlntSpSAPreload = 2886
PlntSpSAStiffness = 52451.01
PlntSpSADamping = 5565.225
PlntSteerTrqLimit = 100
PlntSteerPwrLimit = 1000
PlntSteerWc = 200
PlntSpSAMaxHeight = 0.25
PlntSpMSStatCaster = 0
PlntSpMSStatCamber = 0
PlntSpMSStatToe = 0
PlntSpSAStatCaster = 0
PlntSpSAStatToe = 0
PlntSpKCStatCamber = [0 0 0 0]
PlntSpKCStatCaster = [0 0 0 0]
PlntSpKCStatToe = [0 0 0 0]
PlntSpSAStatCamber = 0
PlntSpKCLatWhlCtrComplLat = [0 0 0 0]
PlntBrkWc = 125.6637
PlntSpKCNrmlWhlRates = [52.45101 52.45101 52.45101 52.45101]
PlntSpKCLatWhlCtrDisp = [0 0 0 0]
PlntSpKCNrmlWhlFrcOff = [2886 2886 2907 2907]
PlntSpKCShckFrcVsCompRate = [5.565225 5.565225 5.565225 5.565225]
PlntVehFzFlt = 10
PlntBrkStcFricCffRear = 0.45
PlntBrkSpoolRear = 50
PlntBrkPadMeanRadiusRear = 0.15
PlntBrkNumPadsRear = 2
PlntBrkKinFricCffRear = 0.35
PlntBrkActrBoreRear = 0.05
PlntBrkActrBoreFrnt = 0.05
PlntBrkKinFricCffFrnt = 0.35
PlntBrkNumPadsFrnt = 2
PlntBrkPadMeanRadiusFrnt = 0.15
PlntBrkSpoolFrnt = 50
PlntBrkStcFricCffFrnt = 0.45
PlntWhlDampCoeffRear = 0.001
PlntWhlInitAngVelRear = 0
PlntWhlDampCoeffFrnt = 0.001
PlntWhlRlxLngthLat = 0.15
PlntWhlRlxLngthLatFrnt = 0.1
PlntWhlRlxLngthLatRear = 0.1
PlntBrkBreakFricVelFrnt = 0.1
PlntBrkBreakFricVelRear = 0.1
PlntBrkViscFricFrnt = 0
PlntBrkViscFricRear = 0
PlntVeh3DOFFrntSuspDamp = 10000
PlntVeh3DOFFrntSuspStiff = 10000
PlntVeh3DOFRearSuspDamp = 10000
PlntVeh3DOFRearSuspStiff = 10000
PlntWhlHubCompStiff = 1000000
PlntWhlHubCompDamp = 40000
PlntWhlCompDamp = 50000
PlntWhlCompStiff = 500000
PlntSteerSlgStf = 15000
PlntSteerUpprFric = 1
PlntSteerPrsFric = 1.0e-5
PlntSteerMaxStf = 10000
PlntSteerMaxUpprFric = 0.2
PlntSteerMaxDamp = 1
PlntSteerTorStf = 30
PlntSteerTorDamp = 1
PlntSteerKngpnOfst = 0.075
PlntSteerLambda = 0.2094395
PlntSteerHbLead = 4.0e-5
PlntSteerStcLdRadius = 0.4
PlntSteerStrgArmLngth = 0.1
PlntSteerTieRodLngth = 0.248
PlntSteerDst = 0.2
PlntSteerEpsilon = 0.9
PlntSteerPnInert = 0.1
PlntSteerRckCsLngth = 1.075
PlntSteerRckGn = 0.01
PlntVehHtchHgtAxl = 0
PlntVehHtchLatDst = 0
PlntVehHtchDst = 2.5
PlntSpKCRollCamber = [0 0]
PlntSpKCRollCaster = [0 0]
PlntSpKCRollSteer = [0 0]
PlntSpKCRollStiffArbFrnt = 0
PlntSpKCRollStiffNoArbFrnt = 0
PlntSpKCRollStiffNoTwstRear = 0
PlntSpKCVrtLdTrnsfr = [0 0 0 0]
PlntSteerRatio = 14
PlntWhlVertDampCoeff = [500 500 500 500]
PlntWhlMass = [9.4649 9.4649 9.4649 9.4649]
PlntWhlInertia = [0.74 0.74 0.74 0.74]
CtrlBcuTrlrBrkGain = 0
PlntVehPitchMomentInertia = 1922.7
PlntWhlNumFrnt = 2
PlntWhlNumRear = 2
PlntSpKCLatWhlCtrComplLng = repmat(0, 2, 4)
PlntVehAeroDragCff = 0.23
PlntSpMSDamping = 2782.612
PlntSpMSStiffness = 26225.5
PlntWhlPrsFrnt = 220000
PlntWhlPrsRear = 220000
PlntWhlInitAngVelFrnt = 0
PlntWhlLdRadiusFrnt = 0.327
PlntWhlLdRadiusRear = 0.327
PlntWhlVelIndpntForceCffFrnt = 0.01
PlntWhlVelIndpntForceCffRear = 0.01
PlntWhlLnrVelForceCompFrnt = 0
PlntWhlLnrVelForceCompRear = 0
PlntWhlQuadVelForceCompFrnt = 0
PlntWhlQuadVelForceCompRear = 0
PlntWhlTirPrsExpFrnt = 0
PlntWhlTirPrsExpRear = 0
PlntWhlNrmlForceExpFrnt = 1
PlntWhlNrmlForceExpRear = 1
PlntWhlLongPeakFctrFrnt = 1
PlntWhlLongPeakFctrRear = 1
PlntWhlLongShapeFctrFrnt = 1.9
PlntWhlLongShapeFctrRear = 1.9
PlntWhlLongStfFctrFrnt = 10
PlntWhlLongStfFctrRear = 10
PlntWhlLongCuvFctrFrnt = 0.97
PlntWhlLongCuvFctrRear = 0.97
PlntWhlVelTolLowVelFrnt = 1
PlntWhlVelTolLowVelRear = 1
PlntWhlVelThreshFrnt = 0.1
PlntWhlVelThreshRear = 0.1
PlntWhlInitVelFrnt = 0
PlntWhlInitVelRear = 0
PlntWhlNomPressFrnt = 220000
PlntWhlNomPressRear = 220000
PlntWhlNomNorlForceFrnt = 4000
PlntWhlNomNorlForceRear = 4000
PlntWhlLongSpdFrnt = 16.7
PlntWhlLongSpdRear = 16.7
PlntWhlLongStiffFrnt = 2175325.388
PlntWhlLongStiffRear = 2175325.388
PlntWhlLatStiffFrnt = 104298.5693
PlntWhlLatStiffRear = 104298.5693
PlntWhlCambStiffFrnt = -3413.1559

PlntWhlCambStiffRear = -3413.1559
PlntWhlKinFricCffFrnt = 0.17601
PlntWhlKinFricCffRear = 0.17601
PlntWhlStcFricCffFrnt = 1.3803
PlntWhlStcFricCffRear = 1.3803
PlntWhlLinYawRateResFrnt = 0
PlntWhlLinYawRateResRear = 0
PlntWhlMaxFricScaleCffFrnt = 1.0295
PlntWhlFricRedFctrFrnt = 0.032684
PlntWhlFricRedFctrRear = 0.032684
PlntWhlMaxFricScaleCffRear = 1.0295
PlntWhlAspctRatioFrnt = 0.59239
PlntWhlAspctRatioRear = 0.59239
PlntWhlInitVertVelFrnt = 0
PlntWhlInitVertVelRear = 0
PlntWhlRollResVelThreshFrnt = 0.1
PlntWhlRollResVelThreshRear = 0.1
PlntWhlRlxLngthFrnt = 0.15
PlntWhlRlxLngthRear = 0.15
PlntWhlMassFrnt = 9.4649
PlntWhlInertiaFrnt = 0.74
PlntWhlWidthFrnt = 0.205
PlntWhlRimRadiusFrnt = 0.1914
PlntWhlUnldRadiusFrnt = 0.30938
PlntWhlVertDampCoeffFrnt = 500
PlntWhlMaxPressFrnt = 1000000
PlntWhlMinPressFrnt = 10000
PlntWhlMaxFzFrnt = 10000
PlntWhlMinFzFrnt = 100
PlntWhlMaxSlipRatioFrnt = 0.6
PlntWhlMinSlipRatioFrnt = -0.6
PlntWhlMaxSlipAngleFrnt = 1.5
PlntWhlMinSlipAngleFrnt = -1.5
PlntWhlMaxCmbrFrnt = 0.2
PlntWhlMinCmbrFrnt = -0.2
PlntWhlMassRear = 9.4649
PlntWhlInertiaRear = 0.74
PlntWhlWidthRear = 0.205
PlntWhlRimRadiusRear = 0.1914
PlntWhlUnldRadiusRear = 0.30938
PlntWhlVertDampCoeffRear = 500
PlntWhlMaxPressRear = 1000000
PlntWhlMinPressRear = 10000
PlntWhlMaxFzRear = 10000
PlntWhlMinFzRear = 100
PlntWhlMaxSlipRatioRear = 0.6
PlntWhlMinSlipRatioRear = -0.6
PlntWhlMaxSlipAngleRear = 1.5
PlntWhlMinSlipAngleRear = -1.5
PlntWhlMaxCmbrRear = 0.2
PlntWhlMinCmbrRear = -0.2
PlntVehInitLongPos = 0
PlntVehInitLatPos = 5.7
PlntVehInitVertPos = 0
PlntVehInitRollAng = 0
PlntVehInitPitchAng = 0
PlntVehInitYawAng = 0