% Simulink data dictionary PassVehMultibody.sldd

PlntVehMultiBodyGeom = struct(
  blue=[0.2 0.4 0.6],
  bluepure=[0.2 0.4 0.6],
  black=[0 0 0],
  yellow=[1 1 0],
  green=[0.2 1 0],
  red=[1 0 0.2],
  orange=[1 0.8 0.4],
  purple=[0.6 0.6 1],
  yellowpale=[0.93 0.93 0.56],
  gray=[0.5 0.5 0.5],
  white=[1 1 1],
  shock=struct(cap=0.0125, piston=0.0125, radius=0.025, dead_length=0.005, bumpstop_len=0.025),
  body=struct(hp=[0 0 0.3225]),
  hp=struct(clr=[1 0 0.2], opc=1, rad=0.025),
  part=struct(opc=1))

PlntVehMultiBodySteerRackTravel = [-75 0 75]
PlntVehMultiBodySteerPinAngle = [-450 0 450]

PlntVehMultiBody = struct(
  Chassis=struct(
    Aero=struct(
      class=struct(Value="sedan"),
      CL=struct(Value=0.05),
      CD=struct(Value=0.29),
      rho_air=struct(Value=1.225),
      ARef=struct(Value=0.29),
      sPressureCentre=struct(Value=[-1.2 0 0.8])),
    Body=struct(
      class=struct(Value="sedan"),
      sAxleF=struct(Value=[0 0 0]),
      sAxleR=struct(Value=[-3.57 0 0]),
      sCG=struct(Value=[-1.6 0 0.4225]),
      sPower=struct(Value=[-1.8 0 0]),
      Width=struct(Value=2.18),
      m=struct(Value=2550),
      J=struct(Value=[930 3320 3990])),
    SuspF=struct(
      class=struct(Value="Linkage"),
      Linkage=struct(
        class=struct(Value="DoubleWishbone"),
        LowerWishbone=struct(
          sInboardF=struct(Units="m", Comments="", Value=[0.225 0.306 -0.18]),
          sInboardR=struct(Units="m", Comments="", Value=[-0.125 0.306 -0.18]),
          sOutboard=struct(Units="m", Comments="", Value=[0.015 0.766 -0.18]),
          m=struct(Units="kg", Comments="", Value=5.2779)),
        UpperWishbone=struct(
          sInboardF=struct(Units="m", Comments="", Value=[0.1 0.451 0.1]),
          sInboardR=struct(Units="m", Comments="", Value=[-0.105 0.451 0.08]),
          sOutboard=struct(Units="m", Comments="", Value=[-0.01 0.706 0.12]),
          m=struct(Units="kg", Comments="", Value=5.4538)),
        Upright=struct(
          sCG=struct(Units="m", Comments="", Value=[0 0.73 0]),
          sWheelCentre=struct(Units="m", Comments="", Value=[0 0.7875 0]),
          m=struct(Units="kg", Comments="", Value=7.0372),
          aToe=struct(Units="deg", Comments="", Value=0),
          aCamber=struct(Units="deg", Comments="", Value=0)),
        TrackRod=struct(
          sInboard=struct(Units="m", Comments="", Value=[0.137083 0.439 -0.125]),
          sOutboard=struct(Units="m", Comments="", Value=[0.142083 0.789 -0.145]),
          m=struct(Units="kg", Comments="", Value=5.2779)),
        Steer=struct(class=struct(Value="Off")),
        Shock=struct(
          sTop=struct(Units="m", Comments="", Value=[-0.000217 0.491985 0.195868]),
          sBottom=struct(Units="m", Comments="", Value=[-0.000217 0.716 -0.18]),
          mPiston=struct(Units="kg", Comments="", Value=3.6529),
          mCylinder=struct(Units="kg", Comments="", Value=4.3158)),
        Endstop=struct(xMax=struct(Units="m", Comments="", Value=0.1), xMin=struct(Units="m", Comments="", Value=-0.1)),
        Upper_Arm_to_Subframe=struct(class=struct(Value="Rigid_1Rev")),
        Lower_Arm_to_Subframe=struct(class=struct(Value="Rigid_1Rev"))),
      Steer=struct(
        class=struct(Value="Rack"),
        Rack=struct(
          sMount=struct(Units="m", Comments="HPRack", Value=[0.137083 0 -0.125]),
          sOutboard=struct(Units="m", Comments="HPInboardTrackRod", Value=[0.137083 0.439 -0.125]),
          m=struct(Units="kg", Comments="Mass", Value=19.792),
          fActuatorCutoff=struct(Units="Hz", Comments="", Value=10)),
        Ratio_Table=struct(
          aWheel=struct(
            Units="rad",
            Comments="Wheel Angle",
            Value=[-7.853982 -7.068583 -6.283185 -5.497787 -4.712389 -3.926991 -3.141593 -2.356194 -1.570796 -0.7853982 0 0.7853982 1.570796 2.356194 3.141593 3.926991 4.712389 5.497787 6.283185 7.068583 7.853982]),
          xRack=struct(
            Units="m",
            Comments="Rack Displacement",
            Value=[-0.075 -0.0675 -0.06 -0.0525 -0.045 -0.0375 -0.03 -0.0225 -0.015 -0.0075 0 0.0075 0.015 0.0225 0.03 0.0375 0.045 0.0525 0.06 0.0675 0.075]))),
      AntiRollBar=struct(class=struct(Value="Simple"), k=struct(Value=50000, Units="N*m/rad"))),
    SuspR=struct(
      class=struct(Value="Linkage"),
      Linkage=struct(
        class=struct(Value="DoubleWishbone"),
        LowerWishbone=struct(
          sInboardF=struct(Units="m", Comments="", Value=[0.225 0.306 -0.142]),
          sInboardR=struct(Units="m", Comments="", Value=[-0.125 0.306 -0.18]),
          sOutboard=struct(Units="m", Comments="", Value=[0 0.766 -0.18]),
          m=struct(Units="kg", Comments="", Value=5.2779)),
        UpperWishbone=struct(
          sInboardF=struct(Units="m", Comments="", Value=[0.1 0.451 0.09]),
          sInboardR=struct(Units="m", Comments="", Value=[-0.105 0.451 0.09]),
          sOutboard=struct(Units="m", Comments="", Value=[0 0.706 0.12]),
          m=struct(Units="kg", Comments="", Value=5.4538)),
        Upright=struct(
          sCG=struct(Units="m", Comments="", Value=[0 0.73 0]),
          sWheelCentre=struct(Units="m", Comments="", Value=[0 0.7875 0]),
          m=struct(Units="kg", Comments="", Value=7.0372),
          aToe=struct(Units="deg", Comments="", Value=0),
          aCamber=struct(Units="deg", Comments="", Value=0)),
        TrackRod=struct(
          sInboard=struct(Units="m", Comments="", Value=[-0.13 0.409 -0.145]),
          sOutboard=struct(Units="m", Comments="", Value=[-0.13 0.759 -0.145]),
          m=struct(Units="kg", Comments="", Value=5.2779)),
        Steer=struct(class=struct(Value="Off")),
        Shock=struct(
          sTop=struct(Units="m", Comments="", Value=[-0.01387 0.491958 0.192868]),
          sBottom=struct(Units="m", Comments="", Value=[-0.013587 0.716 -0.18]),
          mPiston=struct(Units="kg", Comments="", Value=3.6529),
          mCylinder=struct(Units="kg", Comments="", Value=4.3158)),
        Endstop=struct(xMax=struct(Units="m", Comments="", Value=0.1), xMin=struct(Units="m", Comments="", Value=-0.1)),
        Upper_Arm_to_Subframe=struct(class=struct(Value="Rigid_1Rev")),
        Lower_Arm_to_Subframe=struct(class=struct(Value="Rigid_1Rev"))),
      Steer=struct(class=struct(Value="None")),
      AntiRollBar=struct(class=struct(Value="Simple"), k=struct(Value=50000, Units="N*m/rad"))),
    Spring=struct(
      class=struct(Value="Independent"),
      Front=struct(
        class=struct(Value="Linear"),
        sTop=struct(Units="m", Comments="", Value=[-0.000217 0.491985 0.195868]),
        sBottom=struct(Units="m", Comments="", Value=[-0.000217 0.716 -0.18]),
        K=struct(Units="N/m", Comments="", Value=52000),
        xPreload=struct(Units="m", Comments="", Value=0.1265),
        KTable=struct(Units="N/m", Comments="", Value=[52000 52000 52000]),
        unnamed=0,
        xTable=struct(Units="m", Comments="", Value=[-0.1 0 0.1])),
      Rear=struct(
        class=struct(Value="Linear"),
        sTop=struct(Units="m", Comments="", Value=[-0.01387 0.491958 0.192868]),
        sBottom=struct(Units="m", Comments="", Value=[-0.013587 0.716 -0.18]),
        K=struct(Units="N/m", Comments="", Value=52000),
        xPreload=struct(Units="m", Comments="", Value=0.0828),
        KTable=struct(Units="N/m", Comments="", Value=[52000 52000 52000]),
        xTable=struct(Units="m", Comments="", Value=[-0.1 0 0.1]))),
    Damper=struct(
      class=struct(Value="Independent"),
      Front=struct(
        class=struct(Value="Linear"),
        Damping=struct(
          d=struct(Units="N/(m/s)", Comments="", Value=5500),
          sTop=struct(Units="m", Comments="", Value=[-0.000217 0.491985 0.195868]),
          sBottom=struct(Units="m", Comments="", Value=[-0.000217 0.716 -0.18]),
          dTable=struct(Units="N/(m/s)", Comments="", Value=[-5500 0 5500]),
          vTable=struct(Units="m/s", Comments="", Value=[-1 0 1])),
        Endstop=struct(
          xMax=struct(Units="m", Comments="", Value=0.1),
          xMin=struct(Units="m", Comments="", Value=-0.15),
          KxMax=struct(Units="N/m", Comments="", Value=1000000),
          KxMin=struct(Units="N/m", Comments="", Value=1000000),
          dxMax=struct(Units="N/m", Comments="", Value=150),
          dxMin=struct(Units="N/m", Comments="", Value=150),
          xTransition=struct(Units="m", Comments="", Value=0.0001))),
      Rear=struct(
        class=struct(Value="Linear"),
        Damping=struct(
          d=struct(Units="N/(m/s)", Comments="", Value=5500),
          sTop=struct(Units="m", Comments="", Value=[-0.01387 0.491958 0.192868]),
          sBottom=struct(Units="m", Comments="", Value=[-0.013587 0.716 -0.18]),
          dTable=struct(Units="N/(m/s)", Comments="", Value=[-5500 0 5500]),
          vTable=struct(Units="m/s", Comments="", Value=[-1 0 1])),
        Endstop=struct(
          xMax=struct(Units="m", Comments="", Value=0.1),
          xMin=struct(Units="m", Comments="", Value=-0.15),
          KxMax=struct(Units="N/m", Comments="", Value=1000000),
          KxMin=struct(Units="N/m", Comments="", Value=1000000),
          dxMax=struct(Units="N/m", Comments="", Value=150),
          dxMin=struct(Units="N/m", Comments="", Value=150),
          xTransition=struct(Units="m", Comments="", Value=0.0001)))),
    TyreF=struct(
      class=struct(Value="FourPost"),
      rWheel=struct(Value=0.4225, Units="m", Comments=""),
      wWheel=struct(Value=0.235, Units="m", Comments=""),
      m=struct(Value=15.37, Units="kg", Comments=""),
      Jxx=struct(Value=1.22, Units="kg*m^2", Comments=""),
      Jyy=struct(Value=2.35, Units="kg*m^2", Comments=""),
      rRim=struct(Value=0.3048, Units="m", Comments="Width"),
      wRim=struct(Value=0.2032, Units="m", Comments="Width"),
      K=struct(Value=306744, Units="N/m", Comments="Stiffness"),
      d=struct(Value=306.7, Units="N/(m/s)", Comments="Damping"),
      sWheelCentre=struct(Units="m", Comments="", Value=[-0.0478 0.9921 0.3749]),
      sAxle=struct(Value=[0 0 0])),
    TyreR=struct(
      class=struct(Value="FourPost"),
      rWheel=struct(Value=0.4225, Units="m", Comments=""),
      wWheel=struct(Value=0.235, Units="m", Comments=""),
      m=struct(Value=15.37, Units="kg", Comments=""),
      Jxx=struct(Value=1.22, Units="kg*m^2", Comments=""),
      Jyy=struct(Value=2.35, Units="kg*m^2", Comments=""),
      rRim=struct(Value=0.3048, Units="m", Comments="Width"),
      wRim=struct(Value=0.2032, Units="m", Comments="Width"),
      K=struct(Value=306744, Units="N/m", Comments="Stiffness"),
      d=struct(Value=306.7, Units="N/(m/s)", Comments="Damping"),
      sWheelCentre=struct(Units="m", Comments="", Value=[0.005 0.9288 0.292]),
      sAxle=struct(Value=[-3.57 0 0]))),
  Powertrain=struct(
    Driveline=struct(
      DifferentialF=struct(ratio=struct(Units="", Comments="Carrier/Driveshaft", Value=4)),
      DifferentialR=struct(ratio=struct(Units="", Comments="Carrier/Driveshaft", Value=4)),
      ShaftsFL=struct(
        class=struct(Value="CVCV"),
        Transaxle=struct(
          l=struct(Units="m", Comments="", Value=0.3),
          m=struct(Units="kg", Comments="", Value=4.2),
          J=struct(Units="kg*m^2", Comments="", Value=0.0013125),
          sTransaxle=struct(Units="m", Comments="", Value=[0.1 0.15 0.5025])),
        Driveshaft=struct(
          l=struct(Units="m", Comments="", Value=0.4),
          m=struct(Units="kg", Comments="", Value=3.5),
          J=struct(Units="kg*m^2", Comments="", Value=0.0010938)),
        Axle=struct(
          l=struct(Units="m", Comments="", Value=0.2),
          m=struct(Units="kg", Comments="", Value=1.75),
          J=struct(Units="kg*m^2", Comments="", Value=0.00054688))),
      ShaftsFR=struct(
        class=struct(Value="CVCV"),
        Transaxle=struct(
          l=struct(Units="m", Comments="", Value=0.3),
          m=struct(Units="kg", Comments="", Value=4.2),
          J=struct(Units="kg*m^2", Comments="", Value=0.0013125),
          sTransaxle=struct(Units="m", Comments="", Value=[0.1 -0.15 0.5025])),
        Driveshaft=struct(
          l=struct(Units="m", Comments="", Value=0.4),
          m=struct(Units="kg", Comments="", Value=3.5),
          J=struct(Units="kg*m^2", Comments="", Value=0.0010938)),
        Axle=struct(
          l=struct(Units="m", Comments="", Value=0.2),
          m=struct(Units="kg", Comments="", Value=1.75),
          J=struct(Units="kg*m^2", Comments="", Value=0.00054688))),
      ShaftsRL=struct(class=struct(Value="None")),
      ShaftsRR=struct(class=struct(Value="None"))),
    Power=struct(
      class=struct(Value="IdealTwoMotor"),
      fActuatorCutoff=struct(Value=100),
      rActuatorCutoff=struct(Value=100))),
  Brakes=struct(
    class=struct(Value="Pedal"),
    Front=struct(
      DiscAndPad=struct(
        lMeanRadius=struct(Units="m", Comments="", Value=0.15),
        rMuStatic=struct(Units="", Comments="(0-1)", Value=0.7),
        rMuKinetic=struct(Units="", Comments="(0-1)", Value=0.5),
        nTransition=struct(Units="rad/s", Comments="", Value=0.1),
        dViscous=struct(Units="N*m/(rad/s)", Comments="", Value=0.001),
        NPads=struct(Units="", Comments="", Value=2)),
      Caliper=struct(
        lCylinderDiameter=struct(Units="m", Comments="", Value=0.01),
        pMax=struct(Units="", Comments="", Value=2250),
        fActuatorCutoff=struct(Units="1/sec", Comments="", Value=5))),
    Rear=struct(
      DiscAndPad=struct(
        lMeanRadius=struct(Units="m", Comments="", Value=0.1),
        rMuStatic=struct(Units="", Comments="(0-1)", Value=0.7),
        rMuKinetic=struct(Units="", Comments="(0-1)", Value=0.5),
        nTransition=struct(Units="rad/s", Comments="", Value=0.1),
        dViscous=struct(Units="N*m/(rad/s)", Comments="", Value=0.001),
        NPads=struct(Units="", Comments="", Value=2)),
      Caliper=struct(
        lCylinderDiameter=struct(Units="m", Comments="", Value=0.01),
        pMax=struct(Units="", Comments="", Value=1575),
        fActuatorCutoff=struct(Units="1/sec", Comments="", Value=5)))),
  config="Double Wishbone",
  Wheel=struct(Mass=10, Inertia=[1 2]),
  Tire=struct(
    TirFilename="sm_car_heave_roll_tire_245_60_R16.tir",
    Parameters=struct(
      MDI_HEADER=struct(FILE_TYPE="tir"),
      UNITS=struct(LENGTH="meter", FORCE="newton", ANGLE="radians", MASS="kg", TIME="second"),
      MODEL=struct(FITTYP=62, TYRESIDE="Left", LONGVL=16.7, VXLOW=1, ROAD_INCREMENT=0.01, ROAD_DIRECTION=1),
      DIMENSION=struct(UNLOADED_RADIUS=0.35, WIDTH=0.245, RIM_RADIUS=0.203, RIM_WIDTH=0.152, ASPECT_RATIO=0.6),
      OPERATING_CONDITIONS=struct(INFLPRES=240000, NOMPRES=240000),
      INERTIA=struct(MASS=9.7, IXX=0.451, IYY=0.823, BELT_MASS=7.708, BELT_IXX=0.362, BELT_IYY=0.52, GRAVITY=-9.81),
      VERTICAL=struct(
        FNOMIN=5000,
        VERTICAL_STIFFNESS=239450,
        VERTICAL_DAMPING=500,
        MC_CONTOUR_A=0,
        MC_CONTOUR_B=0,
        BREFF=8.39,
        DREFF=0.2587,
        FREFF=0.0736,
        Q_RE0=0.9974,
        Q_V1=0.0008,
        Q_V2=0.0466,
        Q_FZ2=15.416,
        Q_FCX=0.1368,
        Q_FCY=0.1078,
        Q_CAM=0,
        PFZ1=0.7097,
        Q_FCY2=-0.4751,
        Q_CAM1=85.19,
        Q_CAM2=257.4,
        Q_CAM3=0.5119,
        Q_FYS1=-20496.4,
        Q_FYS2=-60000,
        Q_FYS3=88211.7,
        BOTTOM_OFFST=0.01,
        BOTTOM_STIFF=2000000),
      STRUCTURAL=struct(
        LONGITUDINAL_STIFFNESS=298000.4,
        LATERAL_STIFFNESS=142000,
        YAW_STIFFNESS=3800,
        FREQ_LONG=84.223,
        FREQ_LAT=38.124,
        FREQ_YAW=42.23,
        FREQ_WINDUP=72.33,
        DAMP_LONG=0.0678,
        DAMP_LAT=0.065,
        DAMP_YAW=0.056,
        DAMP_WINDUP=0.0116,
        DAMP_RESIDUAL=0.002,
        DAMP_VLOW=0.001,
        Q_BVX=0,
        Q_BVT=0,
        PCFX1=0.1723,
        PCFX2=0,
        PCFX3=0,
        PCFY1=-0.166,
        PCFY2=0,
        PCFY3=0.5492,
        PCMZ1=0),
      CONTACT_PATCH=struct(
        Q_RA1=0.6825,
        Q_RA2=0.7212,
        Q_RB1=1.0616,
        Q_RB2=-1.231,
        ELLIPS_SHIFT=0.8328,
        ELLIPS_LENGTH=1.5724,
        ELLIPS_HEIGHT=1.0221,
        ELLIPS_ORDER=1.6521,
        ELLIPS_MAX_STEP=0.02,
        ELLIPS_NWIDTH=10,
        ELLIPS_NLENGTH=10,
        ENV_C1=0,
        ENV_C2=0),
      INFLATION_PRESSURE_RANGE=struct(PRESMIN=10000, PRESMAX=1000000),
      VERTICAL_FORCE_RANGE=struct(FZMIN=100, FZMAX=10000),
      LONG_SLIP_RANGE=struct(KPUMIN=-1.5, KPUMAX=1.5),
      SLIP_ANGLE_RANGE=struct(ALPMIN=-0.35, ALPMAX=0.35),
      INCLINATION_ANGLE_RANGE=struct(CAMMIN=-0.175, CAMMAX=0.175),
      SCALING_COEFFICIENTS=struct(
        LFZO=1,
        LCX=1,
        LMUX=1,
        LEX=1,
        LKX=1,
        LHX=1,
        LVX=1,
        LCY=1,
        LMUY=1,
        LEY=1,
        LKY=1,
        LKYC=1,
        LKZC=1,
        LHY=1,
        LVY=1,
        LTR=1,
        LRES=1,
        LXAL=1,
        LYKA=1,
        LVYKA=1,
        LS=1,
        LMX=1,
        LVMX=1,
        LMY=1,
        LMP=1),
      LONGITUDINAL_COEFFICIENTS=struct(
        PCX1=1.5752,
        PDX1=1.166,
        PDX2=-0.0076,
        PDX3=0,
        PEX1=-0.0966,
        PEX2=0.0017,
        PEX3=0,
        PEX4=-0.9,
        PKX1=29.61,
        PKX2=4.205,
        PKX3=0.1389,
        PHX1=-0.0024,
        PHX2=0.0005,
        PVX1=0.0745,
        PVX2=-0.0088,
        PPX1=-1.9068,
        PPX2=3,
        PPX3=-0.3383,
        PPX4=-0.4141,
        RBX1=18.435,
        RBX2=16.5,
        RBX3=0,
        RCX1=1.009,
        REX1=-0.8544,
        REX2=0.8675,
        RHX1=0.0084),
      OVERTURNING_COEFFICIENTS=struct(
        QSX1=-0.0078,
        QSX2=0.9557,
        QSX3=0.0159,
        QSX4=0.1244,
        QSX5=1.016,
        QSX6=20,
        QSX7=0.3059,
        QSX8=-0.0433,
        QSX9=0.6269,
        QSX10=0.1422,
        QSX11=0.3477,
        QSX12=0,
        QSX13=0,
        QSX14=0,
        PPMX1=0),
      LATERAL_COEFFICIENTS=struct(
        PCY1=1.5015,
        PDY1=0.8401,
        PDY2=-0.0563,
        PDY3=0,
        PEY1=-0.5276,
        PEY2=1.545,
        PEY3=0.0983,
        PEY4=-6.546,
        PEY5=0,
        PKY1=-26.8535,
        PKY2=1.676,
        PKY3=0.3699,
        PKY4=1.4902,
        PKY5=0,
        PKY6=-0.9004,
        PKY7=-0.2328,
        PHY1=-0.0055,
        PHY2=-0,
        PVY1=-0.0282,
        PVY2=0.0145,
        PVY3=-0.1621,
        PVY4=-0.4908,
        PPY1=-0.6249,
        PPY2=-0.0654,
        PPY3=-0.1668,
        PPY4=0.2834,
        PPY5=0,
        RBY1=12.321,
        RBY2=4.305,
        RBY3=0,
        RBY4=0,
        RCY1=1.0321,
        REY1=-0.1211,
        REY2=0.131,
        RHY1=0.0116,
        RHY2=0,
        RVY1=-0.0065,
        RVY2=-0.0011,
        RVY3=0.1017,
        RVY4=81.1678,
        RVY5=2.2,
        RVY6=15.024),
      ROLLING_COEFFICIENTS=struct(QSY1=0.0082, QSY2=0, QSY3=0.0014, QSY4=0.0001, QSY5=0, QSY6=0, QSY7=1.0801, QSY8=-0.502),
      ALIGNING_COEFFICIENTS=struct(
        QBZ1=9.167,
        QBZ2=-0.534,
        QBZ3=-2.5047,
        QBZ4=0.0759,
        QBZ5=-0.0605,
        QBZ9=36.2424,
        QBZ10=-3.3828,
        QCZ1=1.083,
        QDZ1=0.1451,
        QDZ2=0.026,
        QDZ3=0.2787,
        QDZ4=0,
        QDZ6=-0.0047,
        QDZ7=0.0017,
        QDZ8=-0.1104,
        QDZ9=0.0081,
        QDZ10=0,
        QDZ11=0,
        QEZ1=-4.2987,
        QEZ2=3.2383,
        QEZ3=0.4625,
        QEZ4=-0.1911,
        QEZ5=-0.5441,
        QHZ1=-0.0043,
        QHZ2=-0.0272,
        QHZ3=0.2379,
        QHZ4=-0.2069,
        PPZ1=-0.4402,
        PPZ2=0,
        SSZ1=0.0092,
        SSZ2=0.0385,
        SSZ3=0,
        SSZ4=0),
      TURNSLIP_COEFFICIENTS=struct(
        PDXP1=0.4,
        PDXP2=0,
        PDXP3=0,
        PKYP1=2.1345,
        PDYP1=0.4,
        PDYP2=0,
        PDYP3=0,
        PDYP4=0,
        PHYP1=1,
        PHYP2=0.15,
        PHYP3=0,
        PHYP4=-4,
        PECP1=0.5049,
        PECP2=0.0002,
        QDTP1=10,
        QCRP1=0.2076,
        QCRP2=0.1,
        QBRP1=0.1,
        QDRP1=1))))