% Simulink data dictionary Scenario.sldd

ScnSDSteerFreq = 0.7
ScnCRRadius = 100
ScnCRMaxLatAccel = 0.5
ScnCRLatAccStop = "off"
ScnFHUseRollRate = "off"
ScnManType = 1
ScnFHSteerAmp = 540
ScnTimeToStrtDecel = 20
ScnBrakePedalTime = 20
ScnBrkAx = 0.5
ScnBrkAxdec = 0.5
ScnBrkXbrake = 175
Scn3DFrameRate = 0.03
ScnSDDwellTime = 0.5
ScnSDSteerAmp = 90
ScnFHSteerSpeed = 720
ScnFHInitialDwellTime = 0.5
ScnFHCounterDwellTime = 3
ScnFHReturnTime = 2
ScnFHRollRateZeroCross = 1.5
ScnSSSweepTime = 30
ScnSSSteerAmp = 90
ScnSSFinalFreq = 0.7
ScnDLCLongRefStartPos = 2
ScnDLCVehicleWidth = 2
ScnDLCLatRefOffset = 5.7
ScnDLCLongRefBpt = [0 0.185 0.37 0.555 0.74 0.925 1.11 1.295 1.48 1.665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 59.9]
ScnDLCLatRef = [0 0 0 0 0 0 0 0 0 0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 0.1]
ScnDLCGateLongPos = 175
ScnISLatAccStop = []
ScnISHandwheelRate = 13.5
ScnISMaxHandwheelAng = 270
ScnISSteerHoldTime = 2
ScnISMaxLatAccel = 0.5
ScnStartTime = 2
ScnLongVelRef = 50
ScnLongVelUnit = []
ScnSteerDir = []